% Simulink data dictionary ADCRawToIab.sldd
% references MotorControl.sldd

LPF_BETA = Simulink.Parameter(0.1, DataType="fixdt(0,8,0.00392156862745098,0)", Min=0, Max=1)
adcBuffer = Simulink.Signal(StorageClass="ImportFromFile", HeaderFile="InterfaceBswApp.h", PreserveDimensions=true, DataType="uint16", Dimensions=2, InitialValue="0")
R = Simulink.Parameter(5, StorageClass="Const", HeaderFile="ConstParams.h", DefinitionFile="ConstParams.c", DataType="fixdt(0,8,2^-2,0)", Unit="Ω")  % fixdt(0,8,2^-2,0)
L = Simulink.Parameter(10, StorageClass="Const", HeaderFile="ConstParams.h", DefinitionFile="ConstParams.c", DataType="fixdt(1,32,2^-22,0)", Min=0, Max=15, Unit="H")  % fixdt(1,32,2^-22,0)
ADC_RES = Simulink.Parameter(4096, StorageClass="Const", HeaderFile="ConstParams.h", DefinitionFile="ConstParams.c", DataType="fixdt(1,16,2^-2,0)", Min=0, Max=4096)  % fixdt(1,16,2^-2,0)
CLARKE_CONST = Simulink.Parameter(Simulink.data.Expression(ExpressionString="(1/sqrt(3))"), StorageClass="Define", DataType="fixdt(0,16,2^-12,0)", Min=0, Max=1)  % fixdt(0,16,2^-12,0)
ComparatorBrkPnt = Simulink.Parameter([0 1.65 3.3], StorageClass="Const", HeaderFile="ConstParams.h", DefinitionFile="ConstParams.c", DataType="fixdt(1,16,2^-12,0)", Min=0, Max=3.3)  % fixdt(1,16,2^-4,0)
VoltageOut = Simulink.Parameter([0.3 0 -0.3], StorageClass="Const", HeaderFile="ConstParams.h", DefinitionFile="ConstParams.c", DataType="fixdt(1,16,2^-13,0)", Min=-0.3, Max=0.3, Unit="V")  % fixdt(1,16,2^-10,0)
RShunt_table_data_out = Simulink.Parameter([0.3 0.2998535 0.2997070314 0.2995605 0.2994140628 0.2992676 0.2991210942 0.2989746 0.2988281256 0.2986816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 -0.3], StorageClass="Const", HeaderFile="ConstParams.h", DefinitionFile="ConstParams.c", DataType="fixdt(1,16,2^-13,0)")  % fixdt(1,16,2^-13,0)
ADCRawValue_12bit = Simulink.Parameter([0 1 2 3 4 5 6 7 8 9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 4096], StorageClass="Const", HeaderFile="ConstParams.h", DefinitionFile="ConstParams.c", DataType="uint16")
DRV_V_REF_Div2 = Simulink.Parameter(1.65, StorageClass="Const", HeaderFile="ConstParams.h", DefinitionFile="ConstParams.c", DataType="fixdt(0,8,2^-5,0)", Min=0, Max=3.3, Unit="V")  % fixdt(1,8,2^-5,0)
DRV_V_REF = Simulink.Parameter(3.3, StorageClass="Const", HeaderFile="ConstParams.h", DefinitionFile="ConstParams.c", DataType="fixdt(1,8,2^-5,0)", Min=0, Max=3.3, Unit="V")  % fixdt(1,8,2^-5,0)
DRV_SHUNTR_OHM = Simulink.Parameter(0.007, StorageClass="Const", HeaderFile="ConstParams.h", DefinitionFile="ConstParams.c", DataType="fixdt(1,16,2^-15,0)", Min=0, Max=0.9, Unit="Ω")  % fixdt(1,16,2^-15,0)
ADC_V_OUT = Simulink.Parameter([0 0.0008056664 0.001611333 0.002416999218 0.003222666 0.00402833203 0.004833998436 0.005639665 0.006445331 0.007250997654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 3.30001], StorageClass="Const", HeaderFile="ConstParams.h", DefinitionFile="ConstParams.c", DataType="fixdt(1,16,2^-10,0)")  % fixdt(1,16,2^-10,0)
DRV_GAIN = Simulink.Parameter(10, StorageClass="Const", HeaderFile="ConstParams.h", DefinitionFile="ConstParams.c", DataType="fixdt(1,8,2^-1,0)", Min=0, Max=40)  % fixdt(1,8,2^-1,0)
TimeMS = Simulink.Signal(StorageClass="ExportedGlobal", Unit="ms")
autoCalADCVal = Simulink.Signal(StorageClass="ImportFromFile", HeaderFile="InterfaceBswApp.h", PreserveDimensions=true, DataType="int16", Dimensions=2)  % Extern variable for the ADC offset after the calibration.