% Simulink data dictionary CalcSpeednDir.sldd

rad_s = Simulink.Signal(Unit="rad/sec")
rpm = Simulink.Signal(Unit="rpm")
Sig_Angular_Velocity_radpsec_m = Simulink.Signal(StorageClass="ExportedGlobal", Unit="rad/sec")
Sig_rpm = Simulink.Signal(StorageClass="ExportedGlobal", Unit="rpm")
Sig_Theta_el_cont_m = Simulink.Signal(StorageClass="ImportedExtern", DataType="single")
p = Simulink.Parameter(4, StorageClass="Const", HeaderFile="ConstParams.h", DefinitionFile="ConstParams.c", Owner="pmsm", PreserveDimensions=true, DataType="uint8")