% Simulink data dictionary MotorControl.sldd
% references ADCRawToIab.sldd
% references bsw_Interface.sldd

Tsec = Simulink.Signal(DataType="fixdt(0,32,2^-22,0)", Min=0, Max=500, Unit="sec", InitialValue="0")
Sig_Ia_m = Simulink.Signal(StorageClass="ExportedGlobal")
Sig_Ib_m = Simulink.Signal(StorageClass="ExportedGlobal")
Sig_dAxis_errorSum_m = Simulink.Signal(StorageClass="ExportedGlobal")
Sig_dAxis_PI_out = Simulink.Signal(StorageClass="ExportedGlobal")
Sig_qAxis_errorSum_m = Simulink.Signal(StorageClass="ExportedGlobal")
Sig_qAxis_PI_out = Simulink.Signal(StorageClass="ExportedGlobal")
Sig_Emfobs_errorSum_m = Simulink.Signal(StorageClass="ExportedGlobal")
Sig_Emfobs_PI_out = Simulink.Signal(StorageClass="ExportedGlobal")
Sig_Vdsatu_m = Simulink.Signal(StorageClass="ExportedGlobal")
Sig_Vqsatu_m = Simulink.Signal(StorageClass="ExportedGlobal")
Sig_Va_m = Simulink.Signal(StorageClass="ExportedGlobal")
Sig_Vb_m = Simulink.Signal(StorageClass="ExportedGlobal")
Rs = Simulink.Parameter(0.022, StorageClass="Const", HeaderFile="ConstParams.h", DefinitionFile="ConstParams.c", Owner="pmsm", PreserveDimensions=true, DataType="fixdt(1,32,2^-22,0)")  % fixdt(1,32,2^-22,0)
psim = Simulink.Parameter(0.00375, StorageClass="Const", HeaderFile="ConstParams.h", DefinitionFile="ConstParams.c", Owner="pmsm", PreserveDimensions=true, DataType="fixdt(1,32,2^-22,0)")  % fixdt(1,32,2^-22,0)
Ld = Simulink.Parameter(1.93e-5, StorageClass="Const", HeaderFile="ConstParams.h", DefinitionFile="ConstParams.c", Owner="pmsm", PreserveDimensions=true, DataType="fixdt(1,32,2^-22,0)")  % fixdt(1,32,2^-22,0)
dSoll = Simulink.Parameter(0, StorageClass="Const", HeaderFile="ConstParams.h", DefinitionFile="ConstParams.c", DataType="int8")  % int8
Vnom = Simulink.Parameter(12, StorageClass="Const", HeaderFile="ConstParams.h", DefinitionFile="ConstParams.c", Owner="pmsm", PreserveDimensions=true, DataType="fixdt(1,32,2^-22,0)")  % fixdt(1,32,2^-22,0)
PWM_A_DT = Simulink.Signal(StorageClass="GetSet", HeaderFile="InterfaceBswApp.h", GetFunction="get_$N", SetFunction="set_$N", DataType="uint16", InitialValue="0")
PWM_B_DT = Simulink.Signal(StorageClass="GetSet", HeaderFile="InterfaceBswApp.h", GetFunction="get_$N", SetFunction="set_$N", DataType="uint16", InitialValue="0")
PWM_C_DT = Simulink.Signal(StorageClass="GetSet", HeaderFile="InterfaceBswApp.h", GetFunction="get_$N", SetFunction="set_$N", DataType="uint16", InitialValue="0")

VphMax = Simulink.Parameter(6.92, StorageClass="Const", HeaderFile="ConstParams.h", DataType="fixdt(1,16,2^-8,0)")  % fixdt(1,16,2^-8,0)
  % Val = Vnom*(1/sqrt(3))

CuttOffFreq_c = Simulink.Parameter(4000, StorageClass="ExportedGlobal", DataType="uint16")
Ts = Simulink.Parameter(5.0e-5, Unit="sec")
PositionObsAnlge = Simulink.Signal(StorageClass="ExportedGlobal", DataType="fixdt(1,16,2^-8,0)")
Kp_Iab_EMFobs = Simulink.Parameter(1, StorageClass="ExportedGlobal", DataType="fixdt(1,16,2^-8,0)")  % fixdt(1,16,2^-8,0)
Ki_Iab_EMFobs = Simulink.Parameter(0, StorageClass="ExportedGlobal", DataType="fixdt(1,16,2^-3,0)")  % fixdt(1,16,2^-3,0)
resetPIIntegrator = Simulink.Signal(StorageClass="ExportedGlobal", DataType="boolean", InitialValue="0")
dth_dt = Simulink.Signal(StorageClass="ExportedGlobal", DataType="int16", InitialValue="210")
FluxObsAngle = Simulink.Signal(StorageClass="ExportedGlobal", DataType="fixdt(1,16,2^-8,0)")
Sig_Ibeta_m = Simulink.Signal(StorageClass="ExportedGlobal")
constantAngle = Simulink.Signal(StorageClass="ExportedGlobal")
MaxBckEMFVol_sat_neg = Simulink.Parameter(-12, StorageClass="ExportedGlobal", DataType="fixdt(1,16,2^-2,0)", Min=-100, Max=100, Unit="V")  % fixdt(1,16,2^-2,0)
MaxBckEMFVol_sat_pos = Simulink.Parameter(12, StorageClass="ExportedGlobal", DataType="fixdt(1,16,2^-2,0)", Min=-100, Max=100, Unit="V")  % fixdt(1,32,2^-8,0)
Sig_First_LPF_out = Simulink.Signal(StorageClass="ExportedGlobal")  % 16En6
Sig_Second_LPF_out = Simulink.Signal(StorageClass="ExportedGlobal")  % 16En6
SignVarOfAngle = Simulink.Parameter(1, StorageClass="ExportedGlobal", DataType="fixdt(1,16,2^-8,0)")
EMFobsRS = Simulink.Parameter(0.34, StorageClass="Const", HeaderFile="ConstParams.h", DefinitionFile="ConstParams.c", Owner="pmsm", DataType="single")  % fixdt(1,16,2^-8,0)

EMFobsLdGain = Simulink.Parameter(50000, StorageClass="Const", HeaderFile="ConstParams.h", DefinitionFile="ConstParams.c", DataType="single")  % (1/L) = 100.000
  % fixdt(1,16,2^2,0)

TsIntern = Simulink.Parameter(5.0e-5, StorageClass="ExportedGlobal", DataType="single", Unit="sec")  % fixdt(0,32,2^-24,0)
Sig_sin_m = Simulink.Signal(StorageClass="ExportedGlobal")
Sig_cos_m = Simulink.Signal(StorageClass="ExportedGlobal")
Sig_Valpha_m = Simulink.Signal(StorageClass="ExportedGlobal")
Sig_Vbeta_m = Simulink.Signal(StorageClass="ExportedGlobal")
Sig_Vgamma_m = Simulink.Signal(StorageClass="ExportedGlobal")
Sig_change_SVMalgorithm = Simulink.Signal(StorageClass="ExportedGlobal", DataType="boolean", InitialValue="1")
Sig_Iq_Soll = Simulink.Signal(StorageClass="ExportedGlobal")

TqToIqConst = Simulink.Parameter(1, StorageClass="Const", HeaderFile="ConstParams.h", DefinitionFile="ConstParams.c", Owner="pmsm", DataType="fixdt(1,16,2^-8,0)")  % fixdt(1,16,2^-8,0)
  % Val=2/(3*p*psim)=2/3*Kt
  % old=97.75

resetPIIntegrators = Simulink.Signal(StorageClass="ExportedGlobal", DataType="boolean", InitialValue="0")
resetPIIntegratorDQ = Simulink.Signal(StorageClass="ExportedGlobal", DataType="boolean")
pwmTableData = Simulink.Parameter([0 250 500], StorageClass="Const", HeaderFile="ConstParams.h", DefinitionFile="ConstParams.c", DataType="uint16")
MaxBckEMFVol_sat = Simulink.Parameter(12, StorageClass="Const", HeaderFile="ConstParam.h", DefinitionFile="ConstParams.c", DataType="single", Min=-50, Max=50, Unit="V")
set_AngleInput = Simulink.Signal(StorageClass="ExportedGlobal", DataType="uint8", InitialValue="3")
Sig_Theta_el_cont_m = Simulink.Signal(StorageClass="ExportedGlobal", DataType="single")
isTheFirstStepAfterReset = Simulink.Signal(StorageClass="ExportedGlobal", DataType="uint8")
polepairs = Simulink.Parameter(4, StorageClass="Const", HeaderFile="ConstParams.h", DefinitionFile="ConstParams.c", Owner="pmsm", PreserveDimensions=true, DataType="uint8")
Sig_Id_axis_meas = Simulink.Signal(StorageClass="ExportedGlobal")
Sig_Iq_axis_meas = Simulink.Signal(StorageClass="ExportedGlobal")
d_q_Voltage_Limiter_max = Simulink.Parameter(5.77, StorageClass="ExportedGlobal", DataType="fixdt(1,16,2^-4,0)")  % =Vnom/sqrt(3)
BrkPoints = Simulink.Parameter([-5 0 5], StorageClass="Const", HeaderFile="ConstParams.h", DefinitionFile="ConstParams.c", Owner="pmsm", DataType="single")
d_q_Voltage_Limiter_sat_neg = Simulink.Parameter(-10, StorageClass="ExportedGlobal", DataType="fixdt(1,16,2^-4,0)", Min=-12, Max=0, Unit="V")  % fixdt(1,16,2^-4,0)
d_q_Voltage_Limiter_sat_pos = Simulink.Parameter(10, StorageClass="ExportedGlobal", DataType="fixdt(1,16,2^-4,0)", Min=0, Max=12, Unit="V")  % fixdt(1,16,2^-4,0)
qSoll = Simulink.Signal(StorageClass="ExportedGlobal", DataType="fixdt(1,16,2^-8,0)")  % fixdt(1,16,2^-8,0)
rpmSoll = Simulink.Signal(StorageClass="ExportedGlobal", DataType="uint16")
enableFluxObs = Simulink.Signal(StorageClass="ExportedGlobal", DataType="boolean", InitialValue="0")
activateRPMCntlr = Simulink.Signal(StorageClass="ExportedGlobal", DataType="boolean", InitialValue="0")  % Set to 1 to activate the RPM Controller
Sig_Rpm_measurment = Simulink.Signal(StorageClass="ExportedGlobal", DataType="single", Unit="rpm")
Sig_angle_speed = Simulink.Signal(StorageClass="ExportedGlobal", DataType="single", Unit="rad/sec")
enablePositionObs = Simulink.Signal(StorageClass="ExportedGlobal", DataType="boolean")
Sig_requestMotorBreak = Simulink.Signal(StorageClass="ExportedGlobal", DataType="boolean", InitialValue="0")
Ki_Rpm = Simulink.Parameter(10, StorageClass="ExportedGlobal", DataType="fixdt(0,16,2^-11,0)")  % fixdt(0,16,2^-11,0)
Kp_Rpm = Simulink.Parameter(0.146, StorageClass="ExportedGlobal", DataType="fixdt(0,16,2^-11,0)")  % fixdt(0,16,2^-11,0)
Sig_PQ = Simulink.Signal(StorageClass="ExportedGlobal", DataType="single")
Sig_IQ = Simulink.Signal(StorageClass="ExportedGlobal", DataType="single")
Sig_PD = Simulink.Signal(StorageClass="ExportedGlobal", DataType="single")
Sig_ID = Simulink.Signal(StorageClass="ExportedGlobal", DataType="single")
Sig_PRPM = Simulink.Signal(StorageClass="ExportedGlobal", DataType="single")
Sig_IRPM = Simulink.Signal(StorageClass="ExportedGlobal", DataType="single")
AngleMec_1z = Simulink.Signal(StorageClass="ExportedGlobal", DataType="single")
Sig_theta_el_m = Simulink.Signal(StorageClass="ExportedGlobal", DataType="single", Unit="rad")
Sig_MechanicalAngle = Simulink.Signal(StorageClass="ExportedGlobal", DataType="single", Unit="rad")
Minus_1 = Simulink.Parameter(-1, StorageClass="ExportedGlobal", DataType="single", Min=-1, Max=1)  % Multiply PI Q with -1 for more stability.
Kp_dAxis = Simulink.Parameter(0.146, StorageClass="ExportedGlobal", DataType="fixdt(0,16,2^-10,0)")  % fixdt(0,16,2^-10,0)
Ki_dAxis = Simulink.Parameter(180, StorageClass="ExportedGlobal", DataType="fixdt(0,16,2^-10,0)")  % fixdt(0,16,2^-10,0)
Kp_qAxis = Simulink.Parameter(0.146, StorageClass="ExportedGlobal", DataType="fixdt(0,16,2^-10,0)")  % fixdt(0,16,2^-8,0)
Ki_qAxis = Simulink.Parameter(175, StorageClass="ExportedGlobal", DataType="fixdt(0,16,2^-10,0)")  % fixdt(0,16,2^-8,0)