% Simulink data dictionary PWMtoAngle.sldd
% references MotorControl.sldd

Angle_T = Simulink.Parameter([0; 0.001533; 0.003066; 0.004599; 0.006132; 0.007665; 0.009198; 0.010731; 0.012264; 0.013797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 6.277635], StorageClass="Const", HeaderFile="PWMtoAngle_const.h", DefinitionFile="PWMtoAngle_const.c", PreserveDimensions=true, DataType="fixdt(1,16,2^-10,0)", Unit="rad")
PWMVal_brkp = Simulink.Parameter([0; 1; 2; 3; 4; 5; 6; 7; 8; 9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 4095], StorageClass="Const", HeaderFile="PWMtoAngle_const.h", DefinitionFile="PWMtoAngle_const.c", PreserveDimensions=true, DataType="uint16")
Duty = Simulink.Signal(StorageClass="ImportedExtern", DataType="uint16")
Angle_sensor_in = Simulink.Signal(StorageClass="ExportedGlobal", DataType="single")
setAngleFormat = Simulink.Signal(StorageClass="ExportedGlobal", DataType="boolean", InitialValue="0")
EncoderCounter = Simulink.Signal(StorageClass="ImportedExtern", DataType="uint32")
degresProCounter = Simulink.Parameter(0.003067962, StorageClass="Const", HeaderFile="ConstParams.h", DefinitionFile="ConstParams.c", Owner="EncoderSensor", DataType="single")
continuesAngle = Simulink.Signal(StorageClass="ExportedGlobal")
initialAngle = Simulink.Signal(StorageClass="ExportedGlobal")
afterMergeAngle_tst = Simulink.Signal(StorageClass="ExportedGlobal")
EncoderCounterHasOverflowed = Simulink.Signal(StorageClass="ImportedExtern", DataType="boolean")
MaxValCnt = Simulink.Parameter(uint32(32767), StorageClass="Const", HeaderFile="ConstParams.h", DefinitionFile="ConstParams.c", Owner="AngleCalculator", PreserveDimensions=true)  % The Value came from the matlab command intmax("uint32")
EncoderCounterOld = Simulink.Signal(StorageClass="ExportedGlobal", DataType="int32")
Sig_invert_angleElec = Simulink.Signal(StorageClass="ExportedGlobal", DataType="boolean", InitialValue="1")