% Simulink data dictionary SafetyChecks.sldd
% references MotorControl.sldd

emergency_disable_hardware = Simulink.Signal(StorageClass="GetSet", HeaderFile="InterfaceBswApp.h", SetFunction="emergency_disable_hardware", DataType="boolean")
MaximumCurrentBeforeReaction = Simulink.Parameter(19, StorageClass="ExportedGlobal", DataType="fixdt(0,16,2^-8,0)", Unit="A")  % Maximum current limit before software shutdowns the mosfets.