% Simulink data dictionary bsw_Interface.sldd

Sig_speed_timer_counter_1z = Simulink.Signal(StorageClass="ImportFromFile", HeaderFile="InterfaceBswApp.h", PreserveDimensions=true, DataType="uint16")
Sig_speed_timer_counter = Simulink.Signal(StorageClass="ImportFromFile", HeaderFile="InterfaceBswApp.h", PreserveDimensions=true, DataType="uint16")
EncoderCounterHasOverflowed = Simulink.Signal(StorageClass="ImportFromFile", HeaderFile="InterfaceBswApp.h", PreserveDimensions=true, DataType="boolean", Min=0, Max=1)
Sig_speed_timer_has_overflowed = Simulink.Signal(StorageClass="ImportFromFile", HeaderFile="InterfaceBswApp.h", PreserveDimensions=true, DataType="boolean", Min=0, Max=1)
EncoderCounterHasOverflowed_2 = Simulink.Signal(StorageClass="ImportFromFile", HeaderFile="InterfaceBswApp.h", PreserveDimensions=true, DataType="boolean", Min=0, Max=1)
CounterFactor_us = Simulink.Parameter(500, StorageClass="ImportedDefine", HeaderFile="InterfaceBswApp.h", DataType="uint16")